# Grasshopper definition spatial_printing_tests.gh (Grasshopper 1.0.8)
# plug-ins: Robots

# ---- group: Sim
create_tool = CreateTool(Name="PU_Mixer", TCP=PlaneXY(0, 0, 0), Weight=Slider(2, range=0..100))  # -> Tool, TCP

robots_library = RobotsLibrary({"UR3e", "UR5e", "UR10e", "UR16e", "UR3", "UR5", "UR10", "UR20", "UR30"}, selected="UR5", Type=0)
load_robot_system = LoadRobotSystem(Name=robots_library, Base=PlaneXY(0, 0, 0))
number_slider = Slider(0.865, range=0..1)
createtarget = CreateTarget(Tool=create_tool.Tool, IsCartesian=True)
create_program = CreateProgram(Name="DefaultProgram", RobotSystem=load_robot_system, Targets=createtarget, StepSize=1)  # -> Program, Code, Duration, Warnings, Errors
program_simulation = ProgramSimulation(Program=create_program.Program, Time=0, Normalized=True)  # -> SystemMeshes, JointRotations, Plane, Index, Time, Program, Errors
panel = Panel(create_program.Warnings)
panel_2 = Panel(program_simulation.JointRotations)

# ----
py3 = Python3Script(radius="100", num="4")  # -> out, my_test, middle; inputs radius: Double, num: Int32
# ---------- py3: Python ----------
import os, sys, importlib
# from compas_rhino import unload_modules


gh_dir = os.path.dirname(ghenv.Component.OnPingDocument().FilePath)
sys.path.append(gh_dir)
print(gh_dir)

import experiments

importlib.reload(experiments)

from experiments import exp_01

############--------Main Code----------#########
my_test, middle = exp_01(radius, num)

########--------Output Data---------#########


#############-----------Print----------##########
print(my_test)
# ---------- end py3 ----------
draw = COMPASDraw(cg=py3.my_test)  # -> rg
#   port cg: The COMPAS geometry or datastructure to be drawn.
#   port rg: The Rhino geometry object.
# ---------- draw: Python ----------
# r: compas>=2.14.1
"""
Draws COMPAS geometry in Grasshopper.
"""

from typing import Any

import Grasshopper

from compas.scene import SceneObject


class CompasToRhinoGeometry(Grasshopper.Kernel.GH_ScriptInstance):
    def RunScript(self, cg):
        if not cg:
            return None

        return SceneObject(item=cg).draw()
# ---------- end draw ----------
draw_2 = COMPASDraw(cg=py3.middle)  # -> rg; same code as draw
pln = Plane(program_simulation.Plane)
panel_3 = Panel("-100")
pt = Point(Point(98.33932257, -550.5649013, 0))
X = UnitX(Factor="100")
Y = UnitY(Factor="100")
move = Move(Geometry=pt, Motion=X)  # -> Geometry, Transform
move_2 = Move(Geometry=pt, Motion=Y)  # -> Geometry, Transform
Z = UnitZ(Factor="10")
move_3 = Move(Geometry=pt, Motion=Z)  # -> Geometry, Transform
move_4 = Move(Geometry=move.Geometry, Motion=Z)  # -> Geometry, Transform
move_5 = Move(Geometry=move_2.Geometry, Motion=Z)  # -> Geometry, Transform
pt_2 = Point(move_3.Geometry)
pt_3 = Point(move_4.Geometry)
pt_4 = Point(move_5.Geometry)

# ----
# Transform from Rhino to Robot Space
pln_2 = Plane()
fine_adjust_z_mm = Slider(0.8, range=-5..10)
pt_5 = ConstructPoint(XCoordinate="535.90", YCoordinate="101.40", ZCoordinate="-9.39")
pt_6 = ConstructPoint(XCoordinate="246.86", YCoordinate="-314.78", ZCoordinate="-10.85")
pt_7 = ConstructPoint(XCoordinate="534.35", YCoordinate="-315.60", ZCoordinate="-9.96")
rhino = Python3Script(way_planes=pln_2, wobj_origin=pt_2, wobj_xaxis=pt_3, wobj_xypoint=pt_4, z_safe_margin=fine_adjust_z_mm)  # -> out, transformed_planes; inputs way_planes: list of Plane, wobj_origin: Point3d, wobj_xaxis: Point3d, wobj_xypoint: Point3d, z_safe_margin: Double
# ---------- rhino: Python ----------
import Rhino.Geometry as rg
import math

def set_robot_base(origin, xaxis, xypoint):
    return rg.Plane(origin, xaxis - origin, xypoint - origin)

# def rhino_to_robot_space(rhino_plane, robot_base_plane):
#     T = rg.Transform.PlaneToPlane(rg.Plane.WorldXY, robot_base_plane)
#     robot_plane = rhino_plane.Clone()
#     robot_plane.Transform(T)
#     return robot_plane

def rhino_to_robot_space(rhino_plane, robot_base_plane, flip_z=False):
    T = rg.Transform.PlaneToPlane(rg.Plane.WorldXY, robot_base_plane)
    robot_plane = rhino_plane.Clone()

    if flip_z:
        R = rg.Transform.Rotation(math.pi, robot_plane.XAxis, robot_plane.Origin)
        robot_plane.Transform(R)

    robot_plane.Transform(T)
    return robot_plane

def set_z_safe_margin(planes, safety_margin):
    adjusted = []

    for plane in planes:
        p = plane.Clone()
        p.OriginZ += safety_margin
        adjusted.append(p)

    return adjusted

flip_z = True

robot_base = set_robot_base(wobj_origin, wobj_xaxis, wobj_xypoint)

safer_planes = set_z_safe_margin(way_planes, z_safe_margin)

transformed_planes = []

for plane in safer_planes:
    transformed_planes.append(rhino_to_robot_space(plane, robot_base, flip_z))
# ---------- end rhino ----------
points = PointList(Points=rhino.transformed_planes, Size=10)
